# Grasshopper definition 01 origami structures.gh (Grasshopper 1.0.7)

range = Range(Domain=Domain(0, 1), Steps=Slider(6, range=0..10))
number_slider = Slider(0.99, range=-0.99..0.99)
pow = Power(A=range, B=Slider(1, range=0.6..1.8))
graph = GraphMapper(
    range,
    x0=0,
    x1=1,
    y0=0,
    y1=1,
    container_name="Bezier",
    cpx=[0, 0.2448979616, 0.7528735399, 1],
    cpy=[0.1473430395, 0.5289855003, 0.7367150187, 0.4148536325])
pi = Pi(Factor=1)
abs = Absolute(Value=number_slider)
addition = Addition(A=number_slider, B=Slider(0.3, range=0..1))
addition_2 = Addition(A=pow, B=Slider(0.2, range=0..1))
multiplication = Multiplication(A=pi, B=Slider(0.33, range=0..0.5))
sqrt = SquareRoot(Value=abs)
division = Division(A=addition, B=Slider(3, range=0..10))
ma = MassAddition(Input=graph)  # -> Result, PartialResults
multiplication_2 = Multiplication(A=multiplication, B=sqrt)
pi_2 = Pi(Factor=division)
division_2 = Division(A=ma.PartialResults, B=ma.Result)
multiplication_3 = Multiplication(A=division_2, B=multiplication_2)
cos = Cosine(Value=multiplication_3)
sin = Sine(Value=multiplication_3)
ma_2 = MassAddition(Input=sin)  # -> Result, PartialResults
ma_3 = MassAddition(Input=cos)  # -> Result, PartialResults
number_slider_2 = Slider(6, range=0..10)
neg = Negative(Value=ma_2.PartialResults)
pi_3 = Pi(Factor=Slider(2, range=0..10))
pt = ConstructPoint(XCoordinate=ma_3.PartialResults, YCoordinate=0, ZCoordinate=neg)
division_3 = Division(A=pi_3, B=number_slider_2)
rotate = Rotate(Geometry=pt, Angle=division_3, Plane=PlaneXY(0, 0, 0))  # -> Geometry, Transform
merge = Merge(Data1=graft(pt), Data2=graft(rotate.Geometry))
bang = ExplodeTree(Data=merge)  # -> Branch0, Branch1, Branch2, Branch3, Branch4, Branch5, Branch6
pt_2 = ConstructPoint(XCoordinate=0, YCoordinate=0, ZCoordinate=0)
cluster = Cluster_2(A=pt_2, I=bang.Branch0)  # -> A_2, B, C_2
cluster_2 = Cluster_2(A=cluster.A_2, I=bang.Branch1, C=cluster.C_2)  # -> A_2, B, C_2
cluster_3 = Cluster_2(A=cluster_2.A_2, I=bang.Branch2, C=cluster_2.C_2)  # -> A_2, B, C_2
cluster_4 = Cluster_2(A=cluster_3.A_2, I=bang.Branch3, C=cluster_3.C_2)  # -> A_2, B, C_2
cluster_5 = Cluster_2(A=cluster_4.A_2, I=bang.Branch4, C=cluster_4.C_2)  # -> A_2, B, C_2
cluster_6 = Cluster_2(A=cluster_5.A_2, I=bang.Branch5, C=cluster_5.C_2)  # -> A_2, B, C_2
brep = Brep(flatten([cluster.B, cluster_2.B, cluster_3.B, cluster_4.B, cluster_5.B, cluster_6.B]))
pdecon = Deconstruct(Point=cluster_6.C_2)  # -> XComponent, YComponent, flatten(ZComponent)
bnd = Bounds(Numbers=pdecon.ZComponent)
dedomain = DeconstructDomain(Domain=bnd)  # -> Start, End
neg_2 = Negative(Value=dedomain.Start)
Z = UnitZ(Factor=neg_2)
move = Move(Geometry=brep, Motion=Z)  # -> Geometry, Transform
rotate_2 = Rotate(Geometry=move.Geometry, Angle=pi_2, Plane=PlaneXY(0, 0, 0))  # -> Geometry, Transform
arrpolar = PolarArray(Geometry=rotate_2.Geometry, Plane=PlaneXY(0, 0, 0), Count=number_slider_2, Angle=6.283185307)  # -> Geometry, Transform
wires = BrepWireframe(Brep=arrpolar.Geometry, Density=-1)
preview = CustomPreview(Geometry=arrpolar.Geometry, Material=ColourSwatch(SwatchColor=RGB(230, 230, 230)))

# ==== cluster Cluster_2
C = ClusterInput()
I = ClusterInput()
A = ClusterInput()
ins = InsertItems(List=I, Item=C, Indices=1, Wrap=True)
clean = CleanTree(RemoveNulls=True, RemoveInvalid=True, RemoveEmpty=False, Tree=ins)
shift = ShiftList(List=clean, Shift=-1, Wrap=invert(True))
shift_2 = ShiftList(List=clean, Shift=1, Wrap=invert(True))
cluster = Cluster(A=A, B=shift, D=shift_2)  # -> C, B_3
A_2 = ClusterOutput(clean)
B = ClusterOutput(cluster.B_3)
C_2 = ClusterOutput(cluster.C)

# ==== cluster Cluster
A = ClusterInput()
B = ClusterInput()
D = ClusterInput()
D_2 = Point(D)
A_2 = Point(A)
B_2 = Point(B)
pi = Pi(Factor=1)
division = Division(A=pi, B=Slider(6, range=0..10))
vec2pt = Vector2Pt(PointA=A_2, PointB=B_2, Unitize=invert(False))  # -> Vector, Length
ln = Line(StartPoint=B_2, EndPoint=D_2)
sin = Sine(Value=division)
cos = Cosine(Value=division)
len = Length(Curve=ln)
midpt = CurveMiddle(Curve=ln)
pl = PlaneNormal(Origin=midpt, ZAxis=ln)
division_2 = Division(A=len, B=2)
multiplication = Multiplication(A=cos, B=vec2pt.Length)
multiplication_2 = Multiplication(A=sin, B=vec2pt.Length)
sqr = Square(Value=multiplication_2)
sqr_2 = Square(Value=division_2)
align = AlignPlane(Plane=pl, Direction=vec2pt.Vector)  # -> Plane, Angle
subtraction = Subtraction(A=sqr, B=sqr_2)
pl_origin = PlaneOrigin(Base=align.Plane, Origin=A_2)
sqrt = SquareRoot(Value=subtraction)
cir = Circle(Plane=align.Plane, Radius=sqrt)
cir_2 = Circle(Plane=pl_origin, Radius=multiplication)
ccx = CurveCurve(CurveA=cir, CurveB=cir_2)  # -> Points, ParamsA, ParamsB
item = ListItem(List=ccx.Points, Index=0, Wrap=True)  # -> flatten(Item)
subtraction_2 = Subtraction(A=item, B=A_2)
addition = Addition(A=subtraction_2, B=item)
srf4pt = _4PointSurface(CornerA=A_2, CornerB=D_2, CornerC=addition)
srf4pt_2 = _4PointSurface(CornerA=A_2, CornerB=B_2, CornerC=addition)
weave = Weave(Pattern=[0, 1], Stream0=srf4pt_2, Stream1=srf4pt, NullGaps=False)
join = BrepJoin(Breps=weave)  # -> Breps, Closed
B_3 = ClusterOutput(join.Breps)
C = ClusterOutput(addition)
