# Grasshopper definition 02 quad remesh.gh (Grasshopper 1.0.7)
# plug-ins: Weaverbird, Kangaroo2 Components

# ---- group: cloud1
number_slider = Slider(10, range=0..10)
number_slider_2 = Slider(2.5, range=0..10)
number_slider_3 = Slider(12, range=0..100)
number_slider_4 = Slider(5, range=0..10)
number_slider_5 = Slider(7, range=0..10)
number_slider_6 = Slider(5, range=0..10)
number_slider_7 = Slider(12, range=0..100)
number_slider_8 = Slider(2, range=0..10)

# ----
box = CenterBox(Base=PlaneXY(0, 0, 0), X=number_slider, Y=number_slider_6, Z=number_slider_2)
pop3d = Populate3D(Region=box, Count=number_slider_3, Seed=number_slider_7)
dom = ConstructDomain(DomainStart=number_slider_4, DomainEnd=number_slider_5)
number_slider_9 = Slider(10, range=0..10)
random = Random(Range=dom, Number=number_slider_3, Seed=number_slider_8)
msphere = MeshSphere(Base=pop3d, Radius=random, UCount=number_slider_9, VCount=number_slider_9)
munion = MeshUnion(Meshes=msphere)
volume = Volume(Geometry=munion)  # -> Volume, Centroid
sort = SortList(Keys=volume.Volume, ValuesA=munion)  # -> Keys, reverse(ValuesA)
item = ListItem(List=sort.ValuesA, Index=0, Wrap=True)
qrsettings = QuadRemeshSettings(
    TargetCount=Slider(1900, range=0..10000),
    AdaptiveSize=0,
    AdaptiveCount=False,
    HardEdges=False,
    SeamEdges=0,
    Symmetry=0,
    GuideCurves=0)
qrmesh = QuadRemesh(Mesh=item, Settings=qrsettings)
bipartite = Bipartite(Mesh=qrmesh)
msmooth = SmoothMesh(Mesh=qrmesh, Strength=0.5, SkipNaked=True, Iterations=Slider(5, range=0..10))
subdmesh = SubDFromMesh(Mesh=msmooth, Creases=1, Corners=1, Interpolate=False)

# ---- group: cloud1
neg = Negative(Value=Slider(1, range=0..1))
yz = YZPlane(Origin=Point(0, 0, 0))
pi = Pi(Factor=neg)
rotate = Rotate(Geometry=subdmesh, Angle=pi, Plane=yz)  # -> Geometry, Transform
xy = XYPlane(Origin=Point(0, 0, 0))
mirror = Mirror(Geometry=rotate.Geometry, Plane=xy)  # -> Geometry, Transform

# ----
meshsubd = MeshFromSubD(SubD=mirror.Geometry, Density=Slider(2, range=0..10))
diag = Diagonalize(Mesh=meshsubd)
wbframe = WeaverbirdsPictureFrame(MeshPolylines=diag, Distance=Slider(5, range=0..10), InsetType=0)  # -> flatten(OutMesh)
list = ValueList({"0", "1"}, selected="1")
wbthicken = WeaverbirdsMeshThicken(MeshCurves=wbframe, Distance=Slider(0.04, range=0..1), OffsetType=0)  # -> flatten(OutputMeshCurves)
filter = StreamFilter(Gate=list, Stream0=meshsubd, Stream1=wbthicken)
preview = CustomPreview(Geometry=filter, Material=ColourSwatch(SwatchColor=RGB(255, 255, 255)))
