# Grasshopper definition 03 Coral Growth.gh (Grasshopper 1.0.7)
# plug-ins: Kangaroo2 Components, Anemone

cir = Circle(Plane=PlaneXY(0, 0, 0), Radius=Slider(0.2, range=0..1))
number_slider = Slider(0.08, range=0..0.1)
len = Length(Curve=cir)
division = Division(A=len, B=number_slider)
pi = Pi(Factor=Slider(8, range=0..10))
divide = DivideCurve(Curve=cir, Count=division, Kinks=False)  # -> Points, Tangents, Parameters
lng = ListLength(List=divide.Points)
division_2 = Division(A=pi, B=lng)
series = Series(Start=0, Step=1, Count=lng)
multiplication = Multiplication(A=division_2, B=series)
sin = Sine(Value=multiplication)
multiplication_2 = Multiplication(A=sin, B=Slider(0.05, range=0..0.1))
Z = UnitZ(Factor=multiplication_2)
addition = Addition(A=Z, B=divide.Points)
number_slider_2 = Slider(100, range=0..100)
intcrv = Interpolate(Vertices=addition, Degree=3, Periodic=invert(False), KnotStyle=1)  # -> Curve, Length, Domain
patch = Patch(Curves=intcrv.Curve, Spans=20, Flexibility=1, Trim=True)
mesh = Mesh(patch)
triremesh = TriRemesh(Geometry=mesh, Features=addition, Length=number_slider, Iterations=number_slider_2)  # -> Triangulation, Dual, Creases
loop_start = LoopStart(Data=triremesh.Triangulation, Count=Slider(10, range=0..10))  # -> port, Data, Counter
demesh = DeconstructMesh(Mesh=loop_start.Data)  # -> Vertices, Faces, Colours, Normals
sc = SphereCollide(Points=demesh.Vertices, Radius=Slider(0.08, range=0..0.1), Strength=1)
zombiesolver = ZombieSolver(GoalObjects=flatten(sc), Threshold=1e-10, Tolerance=0.0001)  # -> I, V, O
subtraction = Subtraction(A=zombiesolver.V, B=demesh.Vertices)
division_3 = Division(A=subtraction, B=Slider(3, range=0..10))
addition_2 = Addition(A=demesh.Vertices, B=division_3)
conmesh = ConstructMesh(Vertices=addition_2, Faces=demesh.Faces)
triremesh_2 = TriRemesh(Geometry=conmesh, Length=number_slider, Iterations=number_slider_2)  # -> Triangulation, Dual, Creases
loop_end = LoopEnd(port=loop_start.port, Data=triremesh_2.Triangulation, state="Constant output")  # -> flatten(Data)
