# Grasshopper definition 04 Coral Nest.gh (Grasshopper 1.0.7)
# plug-ins: Weaverbird

range = Range(Domain=Slider(1.1, range=0..2), Steps=10)
Z = UnitZ(Factor=range)
graph = GraphMapper(
    range,
    x0=0,
    x1=1,
    y0=0,
    y1=1,
    container_name="Bezier",
    cpx=[0, 0.2240497172, 0.2753081024, 1],
    cpy=[0.1568528414, 0.5286570787, 0.7578056455, 0.8076477051])
graph_2 = GraphMapper(
    range,
    x0=0,
    x1=1,
    y0=0,
    y1=1,
    container_name="Bezier",
    cpx=[0, 0.2271798104, 0.4507126212, 1],
    cpy=[0.129193306, 0.5581258535, 0.6336216927, 1])
cir = Circle(Plane=Z, Radius=graph)
pi = Pi(Factor=graph_2)
item = ListItem(List=cir, Index=0, Wrap=True)
neg = Negative(Value=pi)
rotate = Rotate(Geometry=cir, Angle=neg, Plane=PlaneXY(0, 0, 0))  # -> Geometry, Transform
pipe = Pipe(Curve=item, Radius=Slider(0.02, range=0..0.1), Caps=0)
divide = DivideCurve(Curve=rotate.Geometry, Count=Slider(14, range=10..20), Kinks=False)  # -> Points, Tangents, Parameters
flip = FlipMatrix(Data=divide.Points)
nurbs = NurbsCurve(Vertices=flip, Degree=3, Periodic=False)  # -> flatten(Curve), Length, Domain
lng = ListLength(List=nurbs.Curve)
dom = ConstructDomain(DomainStart=Slider(0.9, range=0..1), DomainEnd=1)
random = Random(Range=dom, Number=lng, Seed=lng)
subcrv = SubCurve(BaseCurve=reparameterize(nurbs.Curve), Domain=random)
dispatch = Dispatch(List=subcrv, DispatchPattern=[True, False])  # -> ListA, ListB
number_slider = Slider(8, range=0..100)
number_slider_2 = Slider(0.01, range=0..0.1)
divide_2 = DivideCurve(Curve=dispatch.ListB, Count=number_slider, Kinks=False)  # -> simplify(Points), simplify(Tangents), Parameters
divide_3 = DivideCurve(Curve=dispatch.ListA, Count=number_slider, Kinks=False)  # -> simplify(Points), simplify(Tangents), Parameters
multiplication = Multiplication(A=divide_2.Tangents, B=Slider(0.3, range=0..0.3))
multiplication_2 = Multiplication(A=divide_3.Tangents, B=Slider(0.3, range=0..0.3))

number_slider_3 = Slider(1, range=0..10)
number_slider_4 = Slider(3, range=0..10)
path_mapper = PathMapper(divide_2.Points, source="{C}", target="{(C+1)% path_count}")
shift = ShiftList(List=path_mapper, Shift=number_slider_3, Wrap=invert(True))
shift_2 = ShiftList(List=divide_2.Points, Shift=number_slider_4, Wrap=invert(True))
short = ShortestList(ListA=divide_3.Points, ListB=shift_2, TrimMode=2)  # -> ListA, ListB
short_2 = ShortestList(ListA=divide_3.Points, ListB=shift, TrimMode=2)  # -> ListA, ListB

path_mapper_2 = PathMapper(multiplication, source="{C}", target="{(C+1)% path_count}")

shift_3 = ShiftList(List=multiplication, Shift=number_slider_4, Wrap=invert(True))
shift_4 = ShiftList(List=path_mapper_2, Shift=number_slider_3, Wrap=invert(True))
short_3 = ShortestList(ListA=multiplication_2, ListB=shift_3, TrimMode=2)  # -> ListA, ListB
short_4 = ShortestList(ListA=multiplication_2, ListB=shift_4, TrimMode=2)  # -> ListA, ListB

number_slider_5 = Slider(4, range=0..10)
number_slider_6 = Slider(100, range=0..100)
neg_2 = Negative(Value=short_3.ListB)
neg_3 = Negative(Value=short_4.ListB)
polygon = Polygon(Plane=PlaneXY(0, 0, 0), Radius=Slider(0.045, range=0..0.1), Segments=number_slider_5, FilletRadius=0)  # -> Polygon, Length
polygon_2 = Polygon(Plane=PlaneXY(0, 0, 0), Radius=Slider(0.053, range=0..0.1), Segments=number_slider_5, FilletRadius=0)  # -> Polygon, Length
number_slider_7 = Slider(10, range=0..10)
bzspan = BezierSpan(StartPoint=short_2.ListA, StartTangent=short_4.ListA, EndPoint=short_2.ListB, EndTangent=neg_3)  # -> Curve, Length, Domain
bzspan_2 = BezierSpan(StartPoint=short.ListA, StartTangent=short_3.ListA, EndPoint=short.ListB, EndTangent=neg_2)  # -> Curve, Length, Domain
divide_4 = DivideCurve(Curve=subcrv, Count=number_slider_6, Kinks=False)  # -> Points, Tangents, Parameters
scale_nu = ScaleNU(Geometry=polygon_2.Polygon, Plane=PlaneXY(0, 0, 0), ScaleX=1, ScaleY=Slider(0.5, range=0..1), ScaleZ=1)  # -> Geometry, Transform
scale_nu_2 = ScaleNU(Geometry=polygon.Polygon, Plane=PlaneXY(0, 0, 0), ScaleX=1, ScaleY=Slider(0.7, range=0..1), ScaleZ=1)  # -> Geometry, Transform
P = DispatchPattern(invert([True, False]))
lng_2 = ListLength(List=subcrv)
merge = Merge(Data1=bzspan_2.Curve, Data2=bzspan.Curve)  # -> flatten(Result)
bnd = Bounds(Numbers=divide_4.Parameters)
num = Number(P)
remap = RemapNumbers(Value=divide_4.Parameters, Source=bnd, Target=Domain(0, 1))  # -> Mapped, Clipped
pframe = PerpFrame(Curve=graft(subcrv), Parameter=divide_4.Parameters)
repeat = RepeatData(Data=num, Length=lng_2)
explode = Explode(Curve=scale_nu_2.Geometry, Recursive=True)  # -> Segments, Vertices
explode_2 = Explode(Curve=scale_nu.Geometry, Recursive=True)  # -> Segments, Vertices
graph_3 = GraphMapper(
    remap.Mapped,
    x0=0,
    x1=1,
    y0=0,
    y1=1,
    container_name="Bezier",
    cpx=[0, 0, 0.9238655567, 1],
    cpy=[0.515463829, 0.9766072631, 1, 0.07420289516])
multiplication_3 = Multiplication(A=repeat, B=Slider(0.26, range=0..0.4))
lng_3 = ListLength(List=merge)
dom_2 = ConstructDomain(DomainStart=Slider(0.75, range=0..1), DomainEnd=1)
subtraction = Subtraction(A=Slider(1, range=0..1), B=multiplication_3)
random_2 = Random(Range=dom_2, Number=lng_3, Seed=lng_3)
subcrv_2 = SubCurve(BaseCurve=reparameterize(merge), Domain=random_2)
divide_5 = DivideCurve(Curve=subcrv_2, Count=number_slider_7, Kinks=False)  # -> Points, Tangents, Parameters
bnd_2 = Bounds(Numbers=divide_5.Parameters)
remap_2 = RemapNumbers(Value=divide_5.Parameters, Source=bnd_2, Target=Domain(0, 1))  # -> Mapped, Clipped
graph_4 = GraphMapper(
    remap_2.Mapped,
    x0=0,
    x1=1,
    y0=0,
    y1=1,
    container_name="Bezier",
    cpx=[0, 0.2231427878, 0.8100202084, 1],
    cpy=[0.6278158426, 1, 1, 0.01191067696])
pframe_2 = PerpFrame(Curve=graft(subcrv_2), Parameter=divide_5.Parameters)
pi_2 = Pi(Factor=divide_5.Parameters)
multiplication_4 = Multiplication(A=graph_3, B=graft(subtraction))
scale = Scale(Geometry=explode.Vertices, Center=Point(0, 0, 0), Factor=graft(graph_4))  # -> Geometry, Transform
scale_2 = Scale(Geometry=explode_2.Vertices, Center=Point(0, 0, 0), Factor=graft(multiplication_4))  # -> Geometry, Transform
prot = RotatePlane(Plane=pframe_2, Angle=pi_2)
orient = Orient(Geometry=scale_2.Geometry, Source=PlaneXY(0, 0, 0), Target=graft(pframe))  # -> Geometry, Transform
orient_2 = Orient(Geometry=scale.Geometry, Source=PlaneXY(0, 0, 0), Target=graft(prot))  # -> Geometry, Transform
lng_4 = ListLength(List=explode.Segments)
mplane = MeshPlane(Boundary={Plane=PlaneXY(0, 0, 0), Size=Domain2(u=-10..10, v=-10..10)}, WidthCount=lng_4, HeightCount=number_slider_7)  # -> Mesh, Area
mplane_2 = MeshPlane(Boundary={Plane=PlaneXY(0, 0, 0), Size=Domain2(u=-10..10, v=-10..10)}, WidthCount=lng_4, HeightCount=number_slider_6)  # -> Mesh, Area
pshift = ShiftPaths(Data=orient_2.Geometry, Offset=-1)
pshift_2 = ShiftPaths(Data=orient.Geometry, Offset=-1)
demesh = DeconstructMesh(Mesh=mplane.Mesh)  # -> Vertices, Faces, Colours, Normals
demesh_2 = DeconstructMesh(Mesh=mplane_2.Mesh)  # -> Vertices, Faces, Colours, Normals
conmesh = ConstructMesh(Vertices=pshift, Faces=demesh.Faces)  # -> flatten(Mesh)
conmesh_2 = ConstructMesh(Vertices=pshift_2, Faces=demesh_2.Faces)  # -> flatten(Mesh)
mesh = Mesh(pipe)
wbsplitquads = WeaverbirdsConstantQuadsSplitSubdivision(MeshCurves=[conmesh, conmesh_2], Level=1, SmoothNakedEdges=1)
wbcatmullclark = WeaverbirdsCatmullClarkSubdivision(MeshCurves=[wbsplitquads, mesh], Level=1, SmoothNakedEdges=1)
preview = CustomPreview(Geometry=[wbcatmullclark, pipe], Material=ColourSwatch(SwatchColor=RGB(255, 255, 255)))
